# Grasshopper definition 161111_Generic Shading.gh (Grasshopper 0.9.76)
# plug-ins: Python Interpreter

use_previous_sky = BooleanToggle(False)
generate_sky = BooleanToggle(False)
nominal_shading_simulation = BooleanToggle(False)
equivalent_shading_simulation = BooleanToggle(False)
compare_daylight_values = BooleanToggle(False)

# ---- group: Optimisation
galapagos = Galapagos(fitness=abs, gene=optimised_length)

# ----
glazing_orientation = ValueList({"North": 0, "North East": -45, "East": -90, "South East": -135, "South": -180, "South West": -225, "West": -270, "North West": -315}, selected="South")
target_glazing = Geometry(<brep referenced from the Rhino model>)
target_shading = Geometry([<brep referenced from the Rhino model> x2])
other_glazing = Geometry([<brep referenced from the Rhino model> x6])
other_shading = Geometry([<brep referenced from the Rhino model> x12])
number_slider = Slider(0.1, range=0..1)
number_slider_2 = Slider(0.05, range=0..1)
ladybug = Ladybug_Ladybug()  # -> Vviiiiiiiiiizzz; plug-in component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
path = FilePath("C:\EnergyPlusV8-4-0\WeatherData\AUS_NSW.Sydney.947670_IWEC.epw")
number_slider_3 = Slider(12, range=0..100)
number_slider_4 = Slider(21, range=0..100)
dom = ConstructDomain(DomainStart=Slider(1, range=0..1), DomainEnd=number_slider_3)
subtraction = Subtraction(A=number_slider_3, B=1)
geo = Geometry([other_shading, other_glazing, target_shading])
range = Range(Domain=dom, Steps=subtraction)
analysisperiod = Ladybug_AnalysisPeriod(
    fromMonth=range,
    fromDay=number_slider_4,
    fromHour=Slider(8, range=0..10),
    toMonth=range,
    toDay=number_slider_4,
    toHour=Slider(18, range=0..100))  # -> readMe, simplify(analysisPeriod); plug-in component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
importepw = Ladybug_ImportEpw(epwFile=path)  # -> readMe, latitude, location, dryBulbTemperature, dewPointTemperature, relativeHumidity, windSpeed, windDirection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; plug-in component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
gencumulativeskymtx = Ladybug_GenCumulativeSkyMtx(epwFile=path, skyDensity=Slider(1, range=0..10), useOldRes=use_previous_sky, runIt=generate_sky)  # -> readMe, cumulativeSkyMtx; plug-in component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
selectskymtx = Ladybug_selectSkyMtx(
    cumulativeSkyMtx=gencumulativeskymtx.cumulativeSkyMtx,
    analysisPeriod=analysisperiod.analysisPeriod,
    removeDiffuse=False,
    removeDirect=False)  # -> readMe, selectedSkyMtx; plug-in component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
selectskymtx_2 = Ladybug_selectSkyMtx(cumulativeSkyMtx=gencumulativeskymtx.cumulativeSkyMtx, removeDiffuse=False, removeDirect=False)  # -> readMe, selectedSkyMtx; plug-in component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
panel = Panel(importepw.readMe)

# ---- group: North Vector Generation
X = UnitX(Factor=1)
rad = Radians(Degrees=glazing_orientation)
rotate = Rotate(Geometry=X, Angle=rad, Plane=PlaneXY(0, 0, 0))  # -> Geometry, Transform

# ----
radiationanalysis = Ladybug_RadiationAnalysis(
    north=rotate.Geometry,
    geometry=flatten(target_glazing),
    context=flatten(geo),
    gridSize=number_slider,
    disFromBase=number_slider_2,
    selectedSkyMtx=flatten(selectskymtx_2.selectedSkyMtx),
    runIt=nominal_shading_simulation)  # -> readMe, contextMesh, analysisMesh, testPts, testVec, port, flatten(radiationResult), radiationMesh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; plug-in component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

link = Number(radiationanalysis.totalRadiation)
internalise = Number(1857.53772)

optimised_length = Slider(2.12, range=0..5)
optimised_depth_m = Panel(optimised_length)

# ---- group: Glazing Projection Generation
edges = BrepEdges(Brep=target_glazing)  # -> Naked, Interior, NonManifold
eval = EvaluateCurve(Curve=reparameterize(edges.Naked), Parameter=Slider(0.5, range=0..1))  # -> Point, Tangent, Angle
pdecon = Deconstruct(Point=eval.Point)  # -> XComponent, YComponent, ZComponent
sort = SortList(Keys=pdecon.ZComponent, ValuesA=edges.Naked)  # -> Keys, ValuesA
rev = ReverseList(List=sort.ValuesA)
item = ListItem(List=rev, Index=Slider(0, range=0..100), Wrap=True)
top_curve = Geometry(item)
X_2 = UnitX(Factor=optimised_length)
extr = Extrude(Base=top_curve, Direction=X_2)

# ----
radiationanalysis_2 = Ladybug_RadiationAnalysis(
    north=rotate.Geometry,
    geometry=flatten(target_glazing),
    context=flatten([extr, other_glazing, other_shading]),
    gridSize=number_slider,
    disFromBase=number_slider_2,
    selectedSkyMtx=flatten(selectskymtx_2.selectedSkyMtx),
    runIt=equivalent_shading_simulation)  # -> readMe, contextMesh, analysisMesh, testPts, testVec, port, flatten(radiationResult), radiationMesh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; plug-in component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
panel_2 = Panel(radiationanalysis.readMe)
series = Series(Start=Slider(1, range=0..1), Step=1, Count=Slider(8760, range=0..10000))
selectskymtx_3 = Ladybug_selectSkyMtx(cumulativeSkyMtx=gencumulativeskymtx.cumulativeSkyMtx, HOY=graft(series), removeDiffuse=False, removeDirect=False)  # -> readMe, selectedSkyMtx; plug-in component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
selectskymtx_4 = Ladybug_selectSkyMtx(cumulativeSkyMtx=gencumulativeskymtx.cumulativeSkyMtx, removeDiffuse=False, removeDirect=False)  # -> readMe, selectedSkyMtx; plug-in component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
dispatch = Dispatch(List=selectskymtx_3.selectedSkyMtx, DispatchPattern=compare_daylight_values)  # -> ListA, ListB
rtradiationanalysis = Ladybug_RealTimeRadiationAnalysis(selectedSkyMatrix=dispatch.ListA, intersectionMatrix=radiationanalysis.intersectionMtx)  # -> radiationResult; disabled; plug-in component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
rtradiationanalysis_2 = Ladybug_RealTimeRadiationAnalysis(selectedSkyMatrix=dispatch.ListA, intersectionMatrix=radiationanalysis_2.intersectionMtx)  # -> radiationResult; disabled; plug-in component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
panel_3 = Panel(selectskymtx_4.selectedSkyMtx)
ma = MassAddition(Input=simplify(rtradiationanalysis))  # -> flatten(Result), PartialResults
ma_2 = MassAddition(Input=simplify(rtradiationanalysis_2))  # -> flatten(Result), PartialResults
graph = QuickGraph(ma.Result)
panel_4 = Panel(rtradiationanalysis)
graph_2 = QuickGraph(ma_2.Result)
panel_5 = Panel(rtradiationanalysis_2)

# ---- group: Actual, Equivalent, Variation kW/annum
panel_6 = Panel(radiationanalysis_2.totalRadiation)
panel_7 = Panel(internalise)

# ----
subtraction_2 = Subtraction(A=internalise, B=panel_6)
abs = Absolute(Value=subtraction_2)

# ---- group: Actual, Equivalent, Variation kW/annum (continued)
panel_8 = Panel(abs)
