# Grasshopper definition 161214_Vertical Blinds.gh (Grasshopper 0.9.76)
# plug-ins: Python Interpreter

ladybug = Ladybug_Ladybug()  # -> Vviiiiiiiiiizzz; plug-in component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
daylight_saving = Slider(1, range=0..1)
unshaded = Slider(0.2, range=0..1)
crv = Curve(graft([<curve referenced from the Rhino model> x6]))
option_a = Geometry([<brep referenced from the Rhino model> x38])
option_b = Geometry([<brep referenced from the Rhino model> x25])
option_c = Geometry()
context = Geometry([<brep referenced from the Rhino model> x262])
pt = Point(<point referenced from the Rhino model>)
crv_2 = Curve([<curve referenced from the Rhino model> x208])
srf = Surface([<surface referenced from the Rhino model> x2])
glazing_config = Geometry(option_c)
sdivide = DivideSurface(Surface=srf, UCount=Slider(50, range=0..100), VCount=Slider(30, range=0..100))  # -> Points, Normals, Parameters
cluster = Cluster(crv=crv_2)
path = FilePath("C:\EnergyPlusV8-4-0\WeatherData\AUS_NSW.Sydney.947670_IWEC.epw")
subtraction = Subtraction(A=Slider(8, range=0..24), B=daylight_saving)
subtraction_2 = Subtraction(A=Slider(18, range=0..24), B=daylight_saving)
importepw = Ladybug_ImportEpw(epwFile=path)  # -> readMe, latitude, location, dryBulbTemperature, dewPointTemperature, relativeHumidity, windSpeed, windDirection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; plug-in component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
number_slider = Slider(0.5, range=0..1)
subtraction_3 = Subtraction(A=subtraction_2, B=subtraction)
division = Division(A=subtraction_3, B=number_slider)
divlength = DivideLength(Curve=crv, Length=Slider(1, range=0..5))  # -> Points, Tangents, Parameters
number_slider_2 = Slider(3, range=0..10)
number_slider_3 = Slider(1, range=0..1)
addition = Addition(A=division, B=Slider(1, range=0..1))
subtraction_4 = Subtraction(A=Slider(12, range=0..24), B=daylight_saving)
subtraction_5 = Subtraction(A=Slider(16, range=0..24), B=daylight_saving)
subtraction_6 = Subtraction(A=Slider(8, range=0..24), B=daylight_saving)
subtraction_7 = Subtraction(A=Slider(10, range=0..24), B=daylight_saving)
subtraction_8 = Subtraction(A=Slider(14, range=0..24), B=daylight_saving)
series = Series(Start=subtraction, Step=number_slider, Count=addition)  # -> simplify(graft(Series))
pt_2 = Point(divlength.Points)
panel = Panel(series)
neg = Negative(Value=Slider(20, range=0..1000))
series_2 = Series(Start=subtraction_6, Step=number_slider_3, Count=number_slider_2)  # -> simplify(Series)
series_3 = Series(Start=subtraction_7, Step=number_slider_3, Count=number_slider_2)  # -> simplify(Series)
series_4 = Series(Start=subtraction_4, Step=number_slider_3, Count=number_slider_2)  # -> simplify(Series)
series_5 = Series(Start=subtraction_5, Step=number_slider_3, Count=number_slider_2)  # -> simplify(Series)
series_6 = Series(Start=subtraction_8, Step=number_slider_3, Count=number_slider_2)  # -> simplify(Series)

data = Data(series_6)
data_2 = Data(series_3)  # "10-12"
data_3 = Data(series_5)
data_4 = Data(series_2)
data_5 = Data(series_4)
time_period = Data(data_5)

sunpath = Ladybug_SunPath(north=neg, location=importepw.location, hour=series, day="21", month="12", timeStep=1, dailyOrAnnualSunPath=True)  # -> readMe, sunVectors, sunAltitudes, sunAzimuths, port, sunSpheresMesh, sunPathCrvs, legend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; plug-in component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
sunpath_2 = Ladybug_SunPath(
    north=neg,
    location=importepw.location,
    hour=graft(time_period),
    day="21",
    month="12",
    timeStep=1,
    dailyOrAnnualSunPath=True)  # -> readMe, sunVectors, sunAltitudes, sunAzimuths, port, sunSpheresMesh, sunPathCrvs, legend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; plug-in component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
rev = Reverse(Vector=sunpath.sunVectors)
line = LineSDL(Start=flatten(pt_2), Direction=rev, Length=Slider(1000, range=0..1000))  # -> simplify(Line)
mesh = MeshBrep(
    Brep=context,
    Settings={GridMaxCount=0, GridMinCount=16, JaggedSeams=False, MaxEdgeLength=0, MinEdgeLength=0.0001, MinTolerance=0, Refine=True, RefineAngle=0, RelativeTolerance=0.65, SimplePlanes=True, Tolerance=0})
viewfromsun = Ladybug_ViewFromSun(sunVector=sunpath.sunVectors)  # -> readMe; disabled; plug-in component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
rev_2 = Reverse(Vector=sunpath_2.sunVectors)
flatten = FlattenTree(Tree=line, Path="{0}")
mjoin = MeshJoin(Meshes=mesh)
graft = GraftTree(Tree=flatten, IncludeEmptyLists=True, IncludeNullItems=True)
line_2 = LineSDL(Start=flatten(pt_2), Direction=rev_2, Length=Slider(1000, range=0..1000))  # -> simplify(Line)
mcx = MeshCurve(Mesh=mjoin, Curve=graft)  # -> simplify(Points), Faces
mesh_2 = MeshBrep(
    Brep=context,
    Settings={GridMaxCount=0, GridMinCount=16, JaggedSeams=False, MaxEdgeLength=0, MinEdgeLength=0.0001, MinTolerance=0, Refine=True, RefineAngle=0, RelativeTolerance=0.65, SimplePlanes=True, Tolerance=0})
panel_2 = Panel(viewfromsun)
flatten_2 = FlattenTree(Tree=line_2, Path="{0}")
mjoin_2 = MeshJoin(Meshes=mesh_2)
graft_2 = GraftTree(Tree=flatten_2, IncludeEmptyLists=True, IncludeNullItems=True)
lng = ListLength(List=mcx.Points)
mcx_2 = MeshCurve(Mesh=mjoin_2, Curve=graft_2)  # -> simplify(Points), Faces
panel_3 = Panel(lng)
lng_2 = ListLength(List=mcx_2.Points)
smaller = SmallerThan(FirstNumber=lng, SecondNumber=Slider(1, range=0..100))  # -> SmallerThan, OrEqualTo
cull = CullPattern(List=graft, CullPattern=smaller.SmallerThan)
panel_4 = Panel(lng_2)
smaller_2 = SmallerThan(FirstNumber=lng_2, SecondNumber=Slider(1, range=0..100))  # -> SmallerThan, OrEqualTo
clean = CleanTree(RemoveNulls=Toggle(True), RemoveInvalid=True, RemoveEmpty=False, Tree=cull)
cull_2 = CullPattern(List=graft_2, CullPattern=smaller_2.SmallerThan)
crv_3 = Curve(clean)
end = EndPoints(Curve=crv_3)  # -> Start, End
panel_5 = Panel(cull)
clean_2 = CleanTree(RemoveNulls=Toggle(True), RemoveInvalid=True, RemoveEmpty=False, Tree=cull_2)
pt_3 = Point(end.Start)
crv_4 = Curve(clean_2)
cset = CreateSet(List=flatten(pt_3))  # -> Set, Map
end_2 = EndPoints(Curve=crv_4)  # -> Start, End
cset_2 = CreateSet(List=flatten(cset.Map))  # -> Set, Map
panel_6 = Panel(cset.Set)
pt_4 = Point(end_2.Start)
cset_3 = CreateSet(List=flatten(pt_4))  # -> Set, Map
mindex = MemberIndex(Set=cset.Map, Member=cset_2.Set)  # -> Index, Count
panel_7 = Panel(cset_3.Set)
division_2 = Division(A=mindex.Count, B=addition)
multiplication = Multiplication(A=addition, B=unshaded)
panel_8 = Panel(mindex.Count)
subtraction_9 = Subtraction(A=Slider(1, range=0..1), B=division_2)
panel_9 = Panel(subtraction_9)
larger = LargerThan(FirstNumber=mindex.Count, SecondNumber=multiplication)  # -> LargerThan, OrEqualTo
cull_3 = CullPattern(List=cset.Set, CullPattern=larger.LargerThan)
panel_10 = Panel(cull_3)
pt_5 = Point(cull_3)
colour = ColourPicker(PickedColour=RGB(255, 255, 255))
mindex_2 = MemberIndex(Set=cull_3, Member=cset_3.Set)  # -> Index, Count
panel_11 = Panel(mindex_2.Count)
item = ListItem(List=cull_3, Index=mindex_2.Index, Wrap=True)  # -> flatten(Item)
pt_6 = Point(item)
number_slider_4 = Slider(2.18, range=0..10)
number_slider_5 = Slider(0.72, range=0..1)
Z = UnitZ(Factor=1)
rev_3 = Reverse(Vector=Z)

# ---- group: Occupancy Hours
line_3 = LineSDL(Start=pt_5, Direction=rev_3, Length=number_slider_5)
line_4 = LineSDL(Start=pt_5, Direction=Z, Length=number_slider_4)
join = JoinCurves(Curves=[line_4, line_3], Preserve=False)
crv_5 = Curve(join)
preview = CustomPreview(Geometry=crv_5, Shader=colour)

# ----
day_shading = Geometry(crv_5)

# ---- group: Selected Hours
line_5 = LineSDL(Start=pt_6, Direction=rev_3, Length=number_slider_5)
line_6 = LineSDL(Start=pt_6, Direction=Z, Length=number_slider_4)
join_2 = JoinCurves(Curves=[line_6, line_5], Preserve=False)
crv_6 = Curve(join_2)

# ----
lng_3 = ListLength(List=flatten(crv_6))
time_period_shading = Geometry(crv_6)
panel_12 = Panel(lng_3)

# ==== cluster Cluster
crv = ClusterInput()
crv_2 = Curve(crv)
X = UnitX(Factor=Slider(0.5, range=0..1))
rev = Reverse(Vector=X)
extr = Extrude(Base=crv_2, Direction=rev)
extr_2 = Extrude(Base=crv_2, Direction=X)
flip = Flip(Surface=extr)  # -> Surface, Result
geo = Geometry([flip.Surface, extr_2])
colour = ColourPicker(PickedColour=RGB(158, 44, 44))
preview = CustomPreview(Geometry=geo, Shader=colour)
